# Grasshopper definition BoxTest.gh (Grasshopper 0.9.76)
# plug-ins: Colibri

length = Slider(1, range=1..10)
width = Slider(1, range=1..10)
height = Slider(1, range=1..10)
panel = Panel("""6
4
2""")
box = CenterBox(Base=PlaneXY(0, 0, 0), X=length, Y=width, Z=height)
iterator = Iterator(Sliders=[length, width, height], Steps=panel, Fly=Button())
brep = Brep(box)
volume = Volume(Geometry=brep)  # -> Volume, Centroid
panel_2 = Panel(iterator)
imageparameter = ImageParameter(WidthInput="400", HeightInput="400", Bool=Toggle(False))
formatoutputs = FormatOutputs(OutputNames="Volume", OutputValues=volume.Volume)
aggregator = Aggregator(
    FolderPath="C:\Users\bhowes\Desktop\Colibri\Box_1107",
    InputsDataSet=iterator,
    OutputsDataSet=formatoutputs,
    ImageParams=imageparameter,
    SpectaclesElements_3D="dummy.json",
    WriteFile=Toggle(True))
panel_3 = Panel(aggregator)
